vi "index.gviweb"   [LabVIEW NXG 5.0.0]
panel controls:
  "Snap": bool
  "System": i32
panel indicators:
  "Image": string
  "Last Updated": timestamp
uses:
  NI::Skyline::Configuration::Open Configuration Auto.gvi
  WebApp::utilities::Filter Systems by Package.gviweb
  NI::Skyline::TagHTTP::Open Tag.gvi
  NI::Skyline::TagHTTP::Read Tag (String).gvi
  NI::Skyline::TagHTTP::Close Tag (Single).gvi
  NI::Skyline::MessageHTTP::Open.gvi
  NI::Skyline::MessageHTTP::Publish.gvi
  NI::Skyline::MessageHTTP::Close.gvi
diagram:
  call "Open Configuration Auto.gvi"() -> (configuration=w1, error out=w2)
  call "Filter Systems by Package.gviweb"(configuration in=w1, package="sl-imaq-example", error in=w2) -> (configuration out=w3, systems=w4, error out=w5)
  # Place setup code before the loop. For example, perform initial data communication and wire the results into the loop.
  for {
    w6 = each element of w4
    Property Node(instance in=w6) -> ("id"=w9, "alias"=w10)
    append w10 to w7
    append w9 to w8
  }
  Property Node(instance in=reference to "System", "Items"=w7, "Value"=0, error in=w5) -> (error out=w11)
  # Top-Level WebVIs usually contain a While Loop that never stops so that they can continue running as long as the web page is open in the user's web browser.
  while (after w11) {
    Array Index(array=w8) -> (out0[$System]=w12)
    event (timeout = 1000) {
      on "Timeout" {
        Concatenate Strings(w12, ".image") -> w13
        call "Open Tag.gvi"(path=w13, data type="String", configuration=w3) -> (tag=w14, error out=w15)
        call "Read Tag (String).gvi"(tag in=w14, error in=w15) -> (tag out=w16, value=w17, time stamp=w18, error out=w19)
        $Image <- w17
        call "Close Tag (Single).gvi"(tag=w16, error in=w19)
        $"Last Updated" <- w18
      }
      on "Snap" Value changed {
        Concatenate Strings(w12, ".snap") -> w20
        call "Open.gvi"(configuration=w3) -> (message session=w21, error out=w22)
        call "Publish.gvi"(message session in=w21, topic=w20, message="snap", error in=w22) -> (message session out=w23, error out=w24)
        call "Close.gvi"(message session=w23, error in=w24)
      }
    }
    stop if FALSE
  }
